# Dynamo graph AUTORPO часть2(замена названий точек в таблице эксель).dyn (Dynamo 2.4.1.6394)

file_path = Filename(".\Ведомость Точек.xlsx")
string = StringInput("Ведомость")
number = DoubleInput(2)
number_2 = DoubleInput(2)
current = Autodesk.AutoCAD.DynamoNodes.Document.Current()
cogoPointGroups = CogoPointGroups(document=current)
cogoPoints = Autodesk.Civil.DynamoNodes.CogoPointGroup.CogoPoints(cogoPointGroup=cogoPointGroups)
name = Autodesk.Civil.DynamoNodes.CogoPoint.Name(cogoPoint=cogoPoints)
exportExcel = Data.ExportExcel(filePath=file_path, sheetName=string, startRow=number, startCol=number_2, data=name)
