# Dynamo graph AUTORPO1часть(выдает ведомость и графику).dyn (Dynamo 2.10.1.3976)
# packages: Civil3DToolkit 1.1.30

# note: ***********************************************
# Скрипт создает Разбивочный план осей по блокам расположенным на пересечении габаритных осей.
# Инструкция:
# 1. Открываем заготовленый шаблон-файл "Шаблон РПО"
# 2. В шаблоне расположен блок с именем "Центр РПО"
# 3. вставляем в файл необходимые матералы (Архитектура, оси)
# 4. Копируем блок в места необходимых пересечений, удаляем исходный блок
# ....

current = Autodesk.AutoCAD.DynamoNodes.Document.Current()
current_2 = Autodesk.AutoCAD.DynamoNodes.Document.Current()
string = StringInput("ЦентрРПО")

# group: Ввод
ввод_литера_метки = StringInput("А")  # graph input

code_block = CodeBlock { 1; }

# group: Создание меток координат по блоку
blockByName = Autodesk.AutoCAD.DynamoNodes.Document.BlockByName(document=current_2, name=string)
blockReferences = Autodesk.AutoCAD.DynamoNodes.Block.BlockReferences(block=blockByName)
string_2 = StringInput("_01_ГП_меткиРПО")
count = List.Count(list=blockReferences)
range = Range(start=code_block, end=count)
code_block_2 = CodeBlock(a=ввод_литера_метки, b=range) { a+(b); }
byBlockReference = Autodesk.Civil.DynamoNodes.CogoPoint.ByBlockReference(blockReference=blockReferences, layer=string_2, document=current_2, name=code_block_2)  # frozen

# group: ввод
выбери_таблицу = Filename("Z:\Объекты\Макеева 11\03 Проектирование\06 Стадия РД\01 ГП\02_рабочая\Расчетные данные\Ведомость координат паркинга.xlsx")  # graph input; frozen
заглавие_таблицы = StringInput("Ведомость базовых точек координатных осей")  # graph input

string_3 = StringInput("Ведомость")  # frozen

# group: Координаты
coordinateSystem = Autodesk.AutoCAD.DynamoNodes.BlockReference.CoordinateSystem(blockReference=blockReferences)
byCartesianCoordinates = Point.ByCartesianCoordinates(cs=coordinateSystem)

Y = Point.Y(point=byCartesianCoordinates)
X = Point.X(point=byCartesianCoordinates)

# group: Данные точек
number = DoubleInput(2)
number_2 = DoubleInput(0)
join = List.Join()  # unwired: list0, list1, list2
combine = List.Combine(comb=join, list1=code_block_2, list2=Y, list3=X)  # frozen
exportExcel = Data.ExportExcel(filePath=выбери_таблицу, sheetName=string_3, startRow=number, startCol=number_2, data=combine)

# group: Заглавие таблицы
number_3 = DoubleInput(0)
number_4 = DoubleInput(0)
exportExcel_2 = Data.ExportExcel(filePath=выбери_таблицу, sheetName=string_3, startRow=number_3, startCol=number_4, data=заглавие_таблицы)

# group: шапка таблицы
number_5 = DoubleInput(1)
number_6 = DoubleInput(0)
string_4 = StringInput("Номер")
string_5 = StringInput("X")
string_6 = StringInput("Y")
list_create = List.Create(item0=string_4, item1=string_5, item2=string_6)  # frozen
string_7 = StringInput("Наименование")
string_8 = StringInput("Пересечение осей")
number_7 = DoubleInput(0)
shiftIndices = List.ShiftIndices(list=list_create@L2, amount=number_7)

identity = Object.Identity(object=list_create@L2)

# group (continued): шапка таблицы
exportExcel_3 = Data.ExportExcel(filePath=выбери_таблицу, sheetName=string_3, startRow=number_5, startCol=number_6, data=identity)

начало_отсчета_координат = ObjectSelection()  # 1 picked in the model; graph input
coordinateSystem_2 = Autodesk.AutoCAD.DynamoNodes.BlockReference.CoordinateSystem(blockReference=начало_отсчета_координат)
byCartesianCoordinates_2 = Point.ByCartesianCoordinates(cs=coordinateSystem_2)
X_2 = Point.X(point=byCartesianCoordinates_2)
code_block_3 = CodeBlock(x1=X_2, x2=X) { x1-x2; }
abs = Math.Abs(number=code_block_3)
uniqueItems = List.UniqueItems(list=abs)
xline = ObjectsSelection()  # 1 picked in the model
count_2 = List.Count(list=X)
ofRepeatedItem = List.OfRepeatedItem(item=xline, amount=count_2)
code_block_4 = CodeBlock(x1=X_2, x2=X) { x1-x2; }
code_block_5 = CodeBlock(x=code_block_4) { Math.Pow(x,2); }
Y_2 = Point.Y(point=byCartesianCoordinates_2)
code_block_6 = CodeBlock(y1=Y, y2=Y_2) { y1-y2; }
code_block_7 = CodeBlock(y=code_block_6) { Math.Pow(y,2); }
code_block_8 = CodeBlock(x=code_block_5, y=code_block_7) { Math.Sqrt(x+y); }
uniqueItems_2 = List.UniqueItems(list=code_block_8)
offset = Autodesk.AutoCAD.DynamoNodes.PolylineExtensions.Offset(polyline=ofRepeatedItem, offset=uniqueItems_2)
getGeometry = Autodesk.AutoCAD.DynamoNodes.PolylineExtensions.GetGeometry(polyline=offset)
yline = ObjectsSelection()  # 1 picked in the model
count_3 = List.Count(list=Y)
ofRepeatedItem_2 = List.OfRepeatedItem(item=yline, amount=count_3)
code_block_9 = CodeBlock(a=uniqueItems_2) { a*-1; }
offset_2 = Autodesk.AutoCAD.DynamoNodes.PolylineExtensions.Offset(polyline=ofRepeatedItem_2, offset=code_block_9)
getGeometry_2 = Autodesk.AutoCAD.DynamoNodes.PolylineExtensions.GetGeometry(polyline=offset_2)
code_block_10 = CodeBlock(y1=Y_2, y2=Y) { y1-y2; }
abs_2 = Math.Abs(number=code_block_10)
code_block_11 = CodeBlock(a=abs_2) { a*-1; }
XAxis = CoordinateSystem.XAxis(coordinateSystem=coordinateSystem_2)
YAxis = Vector.YAxis()
rotate = Vector.Rotate(vector=XAxis, axis=YAxis)
add = Vector.Add()  # unwired: vector, vectorToAdd
